# Grasshopper definition Herring_brick_fabrication_comb.ghx (Grasshopper 1.0.7)

number_slider = Slider(5, range=0..100)
rotate_angle = Slider(3, range=0..30)
rotate_angle_2 = Slider(7.5, range=0..30)
pt = Point(Point(28.4153801, 37.74651724, 0))

# ---- group: HerringBrcik
python = GhPythonScript(plan_depth=number_slider, height=Slider(5, range=0..100), angle=rotate_angle)  # -> out, planes, planes_base, meshes; inputs plan_depth: Int32, height: Int32
# ---------- python: Python ----------
from compas_rhino import unload_modules
unload_modules('model')

from model import Brick
import Rhino.Geometry as rg
import math

def herring_Brick(plane):
    planes = []
    planes_base =[]
    # first brick
    plane_origin = (plane.Origin
                   +(plane.XAxis * Brick.REFERENCE_WIDTH/2)
                   +(plane.YAxis * Brick.REFERENCE_LENGTH/2))
    
    brick_1_plane = rg.Plane(plane_origin, plane.XAxis, plane.YAxis)
    brick_1_plane.Rotate(math.radians(90), rg.Vector3d.ZAxis)
    planes_base.append(brick_1_plane)
    plane_rot = brick_1_plane.Clone()
    brick_rot = Brick(plane_rot)
    planes.append(brick_rot.picking_plane())
    
    # second brick
    plane_2_origin = (plane.Origin 
                   +(plane.XAxis * (Brick.REFERENCE_LENGTH +0.8))
                   +(plane.YAxis * Brick.REFERENCE_WIDTH/2))
    
    brick_2_plane = rg.Plane(plane_2_origin, plane.XAxis, plane.YAxis)
    brick_2_plane.Rotate(math.radians(0), rg.Vector3d.ZAxis)
    planes_base.append(brick_2_plane)
    plane_2_rot = brick_2_plane.Clone()
    brick_2_rot = Brick(plane_2_rot)
    planes.append(brick_2_rot.picking_plane())
    
    # third brick
    plane_3_origin = (plane.Origin 
                        -(plane.XAxis/2)
                        +(plane.YAxis 
                        *(Brick.REFERENCE_LENGTH + Brick.REFERENCE_WIDTH/2 +1.3)))
    
    brick_3_plane = rg.Plane(plane_3_origin, plane.XAxis, plane.YAxis)
    brick_3_plane.Rotate(math.radians(0), rg.Vector3d.ZAxis)
    planes_base.append(brick_3_plane)
    plane_3_rot = brick_3_plane.Clone()
    brick_3_rot = Brick(plane_3_rot)
    planes.append(brick_3_rot.picking_plane())
    
    # FOUR brick
    plane_origin = (plane.Origin
                   -(plane.XAxis*(Brick.REFERENCE_LENGTH/2 + Brick.REFERENCE_WIDTH/2 + 1.8) )
                   +(plane.YAxis *(Brick.REFERENCE_LENGTH + Brick.REFERENCE_WIDTH +1.8 )))
    
    brick_1_plane = rg.Plane(plane_origin, plane.XAxis, plane.YAxis)
    brick_1_plane.Rotate(math.radians(90), rg.Vector3d.ZAxis)
    planes_base.append(brick_1_plane)
    plane_rot = brick_1_plane.Clone()
    brick_rot = Brick(plane_rot)
    planes.append(brick_rot.picking_plane())
    
    return planes, planes_base


def del_nosupport_brick(plane, planes):
    
    plane_origin = plane.Origin
    planes_orgin = planes.Origin
    distance  = plane.DistanceTo(plane_origin)
    print(distance)

meshes =[]
planes = []
planes_base = []

# rotate and stack bricks 
for i in range(plan_depth):
    for j in range(height):
        # plan gap
        gap_h = Brick.REFERENCE_WIDTH+ 2.5
        # vertcal gap
        gap_v = Brick.REFERENCE_HEIGHT
        if (i + j) < height :
            brick_plane = rg.Plane(rg.Point3d(gap_h * i, gap_h* i, j*gap_v),
                                    rg.Vector3d.XAxis, 
                                    rg.Vector3d.YAxis)
            #T = rg.Transform.Rotation(math.radians(10)*i, rg.Point3d(0,0,0))
            brick_plane.Rotate(math.radians(angle)*j, rg.Vector3d.ZAxis, rg.Point3d(0,0,0))
            planes.extend(herring_Brick(brick_plane)[0])
            # print(herring_Brick(brick_plane)[0][0])
            planes_base.extend(herring_Brick(brick_plane)[1])
        
for plane in planes_base:
    b = Brick(plane)
    meshes.append(b.mesh())
# ---------- end python ----------

python_2 = GhPythonScript(plan_depth=Slider(3, range=0..100), height=Slider(4, range=0..100), angle=rotate_angle_2, rotate_centre=pt)  # -> out, planes, planes_base, meshes; inputs plan_depth: Int32, height: Int32, rotate_centre: Point3d
# ---------- python_2: Python ----------
from compas_rhino import unload_modules
unload_modules('model')

from model import Brick
import Rhino.Geometry as rg
import math

def herring_Brick(plane):
    planes = []
    planes_base =[]
    
    # first brick
    plane_origin = (plane.Origin
                   +(plane.XAxis * Brick.REFERENCE_WIDTH/2)
                   +(plane.YAxis * Brick.REFERENCE_LENGTH/2))
    
    brick_1_plane = rg.Plane(plane_origin, plane.XAxis, plane.YAxis)
    brick_1_plane.Rotate(math.radians(90), rg.Vector3d.ZAxis)
    planes_base.append(brick_1_plane)
    plane_rot = brick_1_plane.Clone()
    brick_rot = Brick(plane_rot)
    planes.append(brick_rot.picking_plane())
    
    # second brick
    plane_2_origin = (plane.Origin 
                   +(plane.XAxis * (Brick.REFERENCE_LENGTH + 1.5))
                   +(plane.YAxis * Brick.REFERENCE_WIDTH/2))
    
    brick_2_plane = rg.Plane(plane_2_origin, plane.XAxis, plane.YAxis)
    brick_2_plane.Rotate(math.radians(0), rg.Vector3d.ZAxis)
    planes_base.append(brick_2_plane)
    plane_2_rot = brick_2_plane.Clone()
    brick_2_rot = Brick(plane_2_rot)
    planes.append(brick_2_rot.picking_plane())
    
    # third brick
    plane_3_origin = (plane.Origin 
                        -(plane.XAxis/2)
                        +(plane.YAxis 
                        *(Brick.REFERENCE_LENGTH + Brick.REFERENCE_WIDTH/2 +1.5)))
    
    brick_3_plane = rg.Plane(plane_3_origin, plane.XAxis, plane.YAxis)
    brick_3_plane.Rotate(math.radians(0), rg.Vector3d.ZAxis)
    planes_base.append(brick_3_plane)
    plane_3_rot = brick_3_plane.Clone()
    brick_3_rot = Brick(plane_3_rot)
    planes.append(brick_3_rot.picking_plane())
    
    # FOUR brick
    plane_origin = (plane.Origin
                   -(plane.XAxis*(Brick.REFERENCE_LENGTH/2 + Brick.REFERENCE_WIDTH/2 + 2.5) )
                   +(plane.YAxis *(Brick.REFERENCE_LENGTH + Brick.REFERENCE_WIDTH + 2.5)))
    
    brick_1_plane = rg.Plane(plane_origin, plane.XAxis, plane.YAxis)
    brick_1_plane.Rotate(math.radians(90), rg.Vector3d.ZAxis)
    planes_base.append(brick_1_plane)
    plane_rot = brick_1_plane.Clone()
    brick_rot = Brick(plane_rot)
    planes.append(brick_rot.picking_plane())
    
    return planes, planes_base


def del_nosupport_brick(plane, planes):
    
    plane_origin = plane.Origin
    planes_orgin = planes.Origin
    distance  = plane.DistanceTo(plane_origin)
    print(distance)

meshes =[]
planes = []
planes_base = []

# rotate and stack bricks 
for i in range(plan_depth):
    for j in range(height):
        # plan gap
        gap_h = Brick.REFERENCE_WIDTH + 1.5 
        # vertcal gap
        gap_v = Brick.REFERENCE_HEIGHT
#        if j%2 == 0:
        brick_plane = rg.Plane(rg.Point3d(gap_h * (i), gap_h* (i), j*gap_v),
                                rg.Vector3d.XAxis, 
                                rg.Vector3d.YAxis)
        #T = rg.Transform.Rotation(math.radians(10)*i, rg.Point3d(0,0,0))
        brick_plane.Rotate(math.radians(angle)*j, rg.Vector3d.ZAxis, rotate_centre)
        planes.extend(herring_Brick(brick_plane)[0])
        # print(herring_Brick(brick_plane)[0][0])
        planes_base.extend(herring_Brick(brick_plane)[1])
#        else:
#            brick_plane = rg.Plane(rg.Point3d(gap_h * (i-1), gap_h* i, j*gap_v),
#                                    rg.Vector3d.XAxis, 
#                                    rg.Vector3d.YAxis)
#            #T = rg.Transform.Rotation(math.radians(10)*i, rg.Point3d(0,0,0))
#            brick_plane.Rotate(math.radians(angle)*j, rg.Vector3d.ZAxis, rotate_centre)
#            planes.extend(herring_Brick(brick_plane)[0])
#            # print(herring_Brick(brick_plane)[0][0])
#            planes_base.extend(herring_Brick(brick_plane)[1])
        
for plane in planes_base:
    b = Brick(plane)
    meshes.append(b.mesh())
# ---------- end python_2 ----------

# ----
pln = Plane(python.planes)
pln_2 = Plane(python.planes_base)
geo = Geometry(python.meshes)
pln_3 = Plane(python_2.planes_base)
geo_2 = Geometry(python_2.meshes)
pln_4 = Plane(python_2.planes)
points = PointList(Points=flatten(pln), Size=Slider(2, range=0..10))
X = UnitX(Factor=Slider(303, range=0..500))
series = Series(Start="1", Step=1, Count=number_slider)  # -> reverse(Series)
Y = UnitY(Factor=Slider(141, range=0..500))
move = Move(Geometry=pln, Motion=X)  # -> Geometry, Transform
move_2 = Move(Geometry=move.Geometry, Motion=Y)  # -> Geometry, Transform
multiplication = Multiplication(A=series, B="4")
pdecon = Deconstruct(Point=move_2.Geometry)  # -> XComponent, YComponent, ZComponent
sort = SortList(Keys=pdecon.ZComponent, ValuesA=move_2.Geometry)  # -> Keys, ValuesA
partition = PartitionList(List=sort.ValuesA, Size=multiplication)
pdecon_2 = Deconstruct(Point=partition)  # -> XComponent, YComponent, ZComponent
geo_3 = Geometry([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])
bricks = GhPythonScript()  # -> out, bricks; disabled
# ---------- bricks: Python ----------
from compas_rhino import unload_modules
unload_modules('model')

import Rhino.Geometry as rg

from model import Brick

import math as m

bricks = []


for i in range(10):  # layer count
    for j in range(10):  # layer length

        if i % 2 == 0:
            x_pos = j * (Brick.REFERENCE_LENGTH+1)
            rotation = m.radians(10)
        else:
            x_pos = j * (Brick.REFERENCE_LENGTH+1) + (Brick.REFERENCE_LENGTH/2)-1
            rotation = m.radians(-10)

        z_pos = i * (Brick.REFERENCE_HEIGHT)

        origin = rg.Point3d(x_pos, 0, z_pos)
        plane = rg.Plane(origin, rg.Vector3d.XAxis, rg.Vector3d.YAxis)
        plane.Rotate(rotation, rg.Vector3d.ZAxis)
        bricks.append(Brick(plane))
# ---------- end bricks ----------
sort_2 = SortList(Keys=pdecon_2.YComponent, ValuesA=partition)  # -> Keys, flatten(ValuesA)
geo_4 = Geometry(sort_2.ValuesA)
fabrication = GhPythonScript(way_plane=geo_4, send=Button())  # -> out, pick_up_brick_planes, rhino_base_way_planes, robot_planes, script; inputs way_plane: list
# ---------- fabrication: Python ----------
from compas_rhino import unload_modules
unload_modules('model')


from model import Brick

import Rhino.Geometry as rg
import simple_comm as c
import simple_ur_script as ur

import math as m

rhino_base_way_planes = way_plane


def tcp(script):
    """ This funktion sets tcp 
    """
    script += ur.set_tcp_by_angles(
        0.0, 0.0, 69.8, m.radians(0.0), m.radians(180.0), m.radians(0))
    return script

def set_robot_base_plane_from_pts():

    pt_0 = rg.Point3d(499, 63, 0)  # base plane origin
    # point on base plane positive x direction
    pt_1 = rg.Point3d(499, 63, 0)
    pt_2 = rg.Point3d(499, 299, 0)  # point on base plane positive xy

    robot_base = rg.Plane(pt_0, pt_1-pt_0, pt_2-pt_0)
    return robot_base

def rhino_to_robot_space(rhino_plane):
    """ this funktion translates planes from the rhino cordinate system to
    the robot cordinate system 
    """
    robot_plane = rhino_plane.Clone()
    _r_matrix = rg.Transform.PlaneToPlane(
        rg.Plane.WorldXY, set_robot_base_plane_from_pts())
    return robot_plane

#### not work



def pickup_brick(pick_up_plane, script):
    """Pick up a brick procedure

    Parameters
    ----------
    pick_up_plane : rhino.geometry.plane
    
    Returns:
    Procedure for pickin up plane
    """
    accel = 0.1    # m/s2
    vel = 0.1      # m/s

    safe_distance = 50
    
    way_planes = []

    safe_plane = pick_up_plane.Clone()
    safe_plane.Translate(rg.Vector3d(0, 0, safe_distance))

    script += ur.move_l(safe_plane, accel, vel)
    way_planes.append(safe_plane)

    script += ur.move_l(pick_up_plane, accel, vel)
    way_planes.append(pick_up_plane)

    script += ur.set_digital_out(0, True)
    script += ur.sleep(1)

    script += ur.move_l(safe_plane, accel, vel)
    way_planes.append(safe_plane)

    return script 

def place_brick(plane, script):
    """
    this function gereates the robotic sequience for placing a brick
    Requires a plane wich describes the possition of the brick"""

    safe_distance = 50
    accel = 0.1
    vel = 0.1
    way_planes = []

    safe_plane = plane.Clone()
    safe_plane.Translate(rg.Vector3d(0, 0, safe_distance))

    script += ur.move_l(safe_plane, accel, vel)
    way_planes.append(safe_plane)

    script += ur.move_l(plane, accel, vel)
    way_planes.append(plane)

    script += ur.set_digital_out(0, False)
    script += ur.sleep(1)

    script += ur.move_l(safe_plane, accel, vel)
    way_planes.append(safe_plane)

    return script

""" Robotic fabrication procedure
"""
script = ""
script = tcp(script)

"""pick _up plane is measured in the robot base plane
"""
pick_up_planes =[]
for i in range(6):  # rows x-direction
    for j in range(10):  # rows y-direction
        x_pos = i * (Brick.REFERENCE_LENGTH)
        y_pos = j * (Brick.REFERENCE_WIDTH)
        origin = rg.Point3d(-60+x_pos, 504.5-y_pos, 4.0)
        pick_up_plane = rg.Plane(origin, rg.Vector3d.XAxis, rg.Vector3d.YAxis)
        pick_up_planes.append(pick_up_plane)
pick_up_planes.reverse()

robot_planes = []

"""We are translating all way_planes from rhino base to robot_base
"""
for rhino_plane in (rhino_base_way_planes):
    robot_planes.append(rhino_to_robot_space(rhino_plane))

for robot_plane, pick_up_plane in zip(robot_planes, pick_up_planes):
    #pick up a plane 
    script = pickup_brick(pick_up_plane, script)
    script = place_brick(robot_plane, script)

script = c.concatenate_script(script)


if send == True :
    c.send_script(script, "192.168.10.10")
# ---------- end fabrication ----------
item = ListItem(List=sort_2.ValuesA, Index=0, Wrap=True)
visualization = GhPythonScript(robot_base=geo_3)  # -> out, geo, transformed_robot_base, v_w_p, s_crv; inputs way_planes: list, robot_base: list of Brep; disabled
# ---------- visualization: Python ----------
"""Generates a 3D model of the wall

Returns
----------
geo : [Rhino Geometry Surface, Rhino Geometry Surface, ...]

"""
from compas_rhino import unload_modules
unload_modules('model')

import Rhino.Geometry as rg

from model import Fabrication
from model import Brick

plane = []
geo = []

for brick in way_planes:
    geo.append(brick.planes())

visualizeFabrication = Fabrication(brick_planes=plane)
visualizeFabrication.procedure(transform=False)


# return 
robot_matrix = visualizeFabrication.robot_transformation()
transformed_robot_base = []
for brep in robot_base:
    trans_brep = brep.Duplicate()
    trans_brep.Transform(robot_matrix)
    transformed_robot_base.append(trans_brep)
# ---------- end visualization ----------
wires = BrepWireframe(Brep=geo_3, Density=-1)
points_2 = PointList(Points=flatten(sort_2.ValuesA), Size=Slider(2, range=0..10))
order = PointOrder(Points=flatten(sort_2.ValuesA))
geo_5 = Geometry(fabrication.rhino_base_way_planes)
geo_6 = Geometry(fabrication.robot_planes)
geo_7 = Geometry(fabrication.pick_up_brick_planes)
preview = CustomPreview(Geometry=wires, Material=ColourSwatch(SwatchColor=RGB(0, 0, 0)))
geo_8 = Geometry(visualization.transformed_robot_base)  # disabled
geo_9 = Geometry(visualization.v_w_p)  # disabled
geo_10 = Geometry(visualization.s_crv)  # disabled
grp = Group(visualization.geo)  # disabled
