# Grasshopper definition populate_bricks.ghx (Grasshopper 1.0.7)

crv = Curve(reparameterize(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))

divdist = DivideDistance(Curve=crv, Distance=Slider(50, range=0..100))  # -> Points, Tangents, Parameters
graph = GraphMapper(
    divdist.Parameters,
    x0=0,
    x1=1,
    y0=0,
    y1=1,
    container_name="Bezier",
    cpx=[0, 0.1085271314, 0.9085272551, 1],
    cpy=[0, 0.4688524604, 0.3934426308, 1])
eval = EvaluateCurve(Curve=crv, Parameter=graph)  # -> Point, Tangent, Angle
dist = Distance(PointA=graft(eval.Point), PointB=eval.Point)  # -> flatten(Distance)
mindist = GhPythonScript(x=dist)  # -> minDist; inputs x: list
# ---------- mindist: Python ----------
X = [i for i in x if i != 0]

minDist = min(X)

print(minDist)
# ---------- end mindist ----------
min_distance = Panel(mindist)

createareas = GhPythonScript(params=graph, starting_curve=crv, layers=Slider(6, range=0..10))  # -> out, areas, bbox; inputs params: list, starting_curve: Curve, layers: Int32
# ---------- createareas: Python ----------
import rhinoscriptsyntax as rs
import Rhino.Geometry as rg
from compas_rhino import unload_modules
unload_modules('model')

from model import Brick, Area

curve = starting_curve

areas_dict = {}

def areas_on_curve(crv, layer, params=params):
    layer_areas = []
    for i, _ in enumerate(params[:-1]):
        key = "L{}A{}".format(layer, i)
        area = Area(initial_curve=crv, start_param=params[i], end_param=params[i+1], layer=layer, area_index=i)
        areas_dict[key] = area
        layer_areas.append(area)
    return layer_areas
    
def move_curve_up(crv, height=Brick.REFERENCE_HEIGHT, trim_factor=0.05):
    V = rg.Vector3d.ZAxis * height
    crv.Translate(V)
    length = crv.GetLength()
    new_length = length * (1.0 - trim_factor)
    trim_length = (length - new_length) / 2
    _ , p0 = crv.LengthParameter(trim_length)
    _ , p1 = crv.LengthParameter(length - trim_length)
    trim = crv.Trim(rg.Interval(p0,p1))
    trim.Domain = rg.Interval(0.0, 1.0)
    return trim

areas_list = []

for i in range(layers):
    layer_areas = areas_on_curve(crv=curve, layer=i)
    areas_list.append(layer_areas)
    curve = move_curve_up(curve)


"""
To check and visualize parts
"""
def bbox_boolean_intersect(bbox_a, bbox_b):
    a_min_x = bbox_a.Min.X
    a_min_y = bbox_a.Min.Y
    b_min_x = bbox_b.Min.X
    b_min_y = bbox_b.Min.Y
    a_max_x = bbox_a.Max.X
    a_max_y = bbox_a.Max.Y
    b_max_x = bbox_b.Max.X
    b_max_y = bbox_b.Max.Y
    
    if (a_min_x < b_max_x) and (a_max_x > b_min_x) and (a_min_y < b_max_y) and (a_max_y > b_min_y):
        return True
    else:
        return False
    
    
#curves = []
bbox = []

for a in areas_list[5]:
    bbox_a = a.project_bbox_extend_on_ground()
    sub_layer = areas_list[a.sub_layer()]
    for sub_area in sub_layer:
        bbox_b = sub_area.project_bbox_extend_on_ground()
        if bbox_boolean_intersect(bbox_a, bbox_b) is True:
            print(a.area_key, sub_area.area_key)
# ---------- end createareas ----------
